% Simulink data dictionary project.sldd

cfgFixedStep = Simulink.ConfigSet(StartTime="0", StopTime="10", FixedStep="Ts_sim", Solver="ode4", ProdHWDeviceType="Intel->x86-64 (Windows64)", SystemTargetFile="grt.tlc", TargetLang="C")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

Bus_State = Simulink.Bus()
  x: double[3]
  v: double[3]
  q: double[4]
  Omega: double[3]

Bus_Cmd = Simulink.Bus()
  F_des: double
  q_des: double[4]
  q_ref: double[4]
  Omega_ref: double[3]
  tau_ref: double[3]
  q_ext: double[4]
  estop: uint8
  ack: boolean

Bus_Cmd_flat = Simulink.Bus()
  mocap_pos: double[3]
  q_ext: double[4]
  p_ref: double[3]
  v_ref: double[3]
  a_ref: double[3]
  j_ref: double[3]
  s_ref: double[3]
  yaw_ref: double[3]
  estop: uint8
  ack: boolean

Bus_IMU = Simulink.Bus()
  imu_gyro: double[3]
  imu_acc: double[3]

Bus_Mocap = Simulink.Bus()
  mocap_pos: double[3]
  mocap_quat: double[4]